test file "test_flowsensing_inout"

suite "New Test Suite 1"

  case "New Test Case 1" [baseline]
    model test_flowsensing_inout, harness test_flowsensing_inout_Harness2
    parameter set "FaultMode 0 Vcc 5  MinVcc 0": CustomValue = 2, FaultMode = 0, MinVcc = 0, Vcc = 5  % base workspace
    parameter set "FaultMode 0 Vcc 4.5 MinVcc 0": CustomValue = 2, FaultMode = 0, MinVcc = 0, Vcc = 4.5  % base workspace
    parameter set "FaultMode 1 Vcc 5 MinVcc 0": CustomValue = 2, FaultMode = 1, MinVcc = 0, Vcc = 5  % base workspace
    parameter set "FaultMode 2 Vcc 5 MinVcc 0": CustomValue = 2, FaultMode = 2, MinVcc = 0, Vcc = 5  % base workspace
    parameter set "FaultMode 0 Vcc 5  MinVcc 1": CustomValue = 2, FaultMode = 0, MinVcc = 1, Vcc = 5  % base workspace
    parameter set "FaultMode 0 Vcc 5  MinVcc 2": CustomValue = 2, FaultMode = 0, MinVcc = 2, Vcc = 5  % base workspace
    parameter set "FaultMode 0 Vcc 4.5  MinVcc 5": CustomValue = 2, FaultMode = 0, MinVcc = 5, Vcc = 4.5  % base workspace
    parameter set "FaultMode 0 Vcc 4  MinVcc 4.5": CustomValue = 2, FaultMode = 0, MinVcc = 4.5, Vcc = 4  % base workspace
    pre-load callback:
      Vcc=5;
      MinVcc = 0;
      FaultMode = 0;
      CustomValue = 2;
    assessment "Assessment1": At any point of time, whenever FaultMode ==single(1) is true then, with a delay of at most 0.01, FreqReal==single(0) must be true
    assessment "Assessment2": At any point of time, whenever FaultMode ==single(2) is true then, with a delay of at most 0.01, FreqReal==CustomValue must be true
    assessment "Assessment3": At any point of time, whenever Vcc<single(minVcc) is true then, with a delay of at most 0.01, FreqReal==single(0) must be true
    assessment "Assessment4": At any point of time, whenever (FlowIn<=MinFlow) & (FaultMode ==single(0)) is true then, with a delay of at most 0.01, FreqReal==single(0) must be true
      MinFlow: signal test_flowsensing_inout_Harness2/Input Conversion Subsystem, port 4
      FlowIn: signal test_flowsensing_inout_Harness2/Input Conversion Subsystem, port 2
      FaultMode: signal test_flowsensing_inout_Harness2/test_flowsensing_inout|test_flowsensing_inout/Data Type Conversion8, port 1
      FreqReal: signal test_flowsensing_inout_Harness2/test_flowsensing_inout|test_flowsensing_inout/hil_flowsensing_lib, port 1
      CustomValue: signal test_flowsensing_inout_Harness2/test_flowsensing_inout|test_flowsensing_inout/Data Type Conversion6, port 1
      Vcc: signal test_flowsensing_inout_Harness2/test_flowsensing_inout|test_flowsensing_inout/Data Type Conversion5, port 1
      minVcc: signal test_flowsensing_inout_Harness2/test_flowsensing_inout|test_flowsensing_inout/Data Type Conversion7, port 1
    iterations:
      Iteration1: ParameterSet "FaultMode 0 Vcc 5  MinVcc 0", TestSequenceScenario "FlowIn_5"
      Iteration2: ParameterSet "FaultMode 0 Vcc 4.5 MinVcc 0", TestSequenceScenario "FlowIn_5"
      Iteration3: ParameterSet "FaultMode 1 Vcc 5 MinVcc 0", TestSequenceScenario "FlowIn_5"
      Iteration4: ParameterSet "FaultMode 2 Vcc 5 MinVcc 0", TestSequenceScenario "FlowIn_5"
      Iteration5: ParameterSet "FaultMode 0 Vcc 5  MinVcc 1", TestSequenceScenario "FlowIn_5"
      Iteration6: ParameterSet "FaultMode 0 Vcc 5  MinVcc 2", TestSequenceScenario "FlowIn_5"
      Iteration7: ParameterSet "FaultMode 0 Vcc 4.5  MinVcc 5", TestSequenceScenario "FlowIn_5"
      Iteration8: ParameterSet "FaultMode 0 Vcc 4  MinVcc 4.5", TestSequenceScenario "FlowIn_5"
      Iteration9: ParameterSet "FaultMode 0 Vcc 5  MinVcc 0", TestSequenceScenario "FlowIn_zero"
      Iteration10: ParameterSet "FaultMode 0 Vcc 4.5 MinVcc 0", TestSequenceScenario "FlowIn_zero"
      Iteration11: ParameterSet "FaultMode 1 Vcc 5 MinVcc 0", TestSequenceScenario "FlowIn_zero"
      Iteration12: ParameterSet "FaultMode 2 Vcc 5 MinVcc 0", TestSequenceScenario "FlowIn_zero"
      Iteration13: ParameterSet "FaultMode 0 Vcc 5  MinVcc 1", TestSequenceScenario "FlowIn_zero"
      Iteration14: ParameterSet "FaultMode 0 Vcc 5  MinVcc 2", TestSequenceScenario "FlowIn_zero"
      Iteration15: ParameterSet "FaultMode 0 Vcc 4.5  MinVcc 5", TestSequenceScenario "FlowIn_zero"
      Iteration16: ParameterSet "FaultMode 0 Vcc 4  MinVcc 4.5", TestSequenceScenario "FlowIn_zero"
      Iteration17: ParameterSet "FaultMode 0 Vcc 5  MinVcc 0", TestSequenceScenario "FlowIn_lower_MinFlow"
      Iteration18: ParameterSet "FaultMode 0 Vcc 4.5 MinVcc 0", TestSequenceScenario "FlowIn_lower_MinFlow"
      Iteration19: ParameterSet "FaultMode 0 Vcc 5  MinVcc 1", TestSequenceScenario "FlowIn_lower_MinFlow"
      Iteration20: ParameterSet "FaultMode 0 Vcc 5  MinVcc 2", TestSequenceScenario "FlowIn_lower_MinFlow"